# Grasshopper definition COS200 Final.gh (Grasshopper 1.0.7)

max_height = Slider(22, range=2..50)
test = Slider(11, range=1..50)
detail = Slider(10, range=2..30)
detail_2 = Slider(10, range=2..30)
curve = Curve(<curve referenced from the Rhino model>)
control_polygon = ControlPolygon(Curve=curve)  # -> Polygon, Points
segment_lengths = SegmentLengths()  # -> ShortestLength, ShortestDomain, LongestLength, LongestDomain
populate_2d = Populate2D(Region=curve, Count=100, Seed=1)
ghpython_script = GhPythonScript(Area=curve, S1_Detail=detail, S2_Detail=detail_2, Max_Height=max_height, test_val=test)  # -> console, points, pList; inputs Area: Curve, Max_Height: Int32, test_val: Int32
# ---------- ghpython_script: Python ----------
import rhinoscriptsyntax as rs
import ghpythonlib.components as ghp
import random as r
import Rhino

# Create Empty Point List
points = []
#points = ghp.Populate2D(Area, Detail, 1)
#cornerPoints = ghp.ControlPolygon(Area)[1]

SL = ghp.SegmentLengths(Area)

side_len1 = round(float(SL[0]))
side_len2 = round(float(SL[2]))
#print(side_len1, side_len2)

#side_len1/S1_Detail

# Creating Point Array
for e in range(int(S2_Detail)+1):
    for i in range(int(S1_Detail)+1):
        points.append(rs.CreatePoint((side_len1/S1_Detail*i),side_len2/S2_Detail*e,0))

#points.append(rs.CreatePoint(1,1,1))
#pList = ghp.Merge(points, cornerPoints)

# Setting Base Thickness
rs.MoveObjects(points, ghp.UnitZ(5))

# Randomizing Heights
for point in points:
    rs.MoveObject(point, ghp.UnitZ(r.randint(5,10)))

# Proper U-Count
#UC = 

surface = ghp.SurfaceFromPoints(points, side_len1, True)
# ---------- end ghpython_script ----------
merge = Merge(Data1=control_polygon.Points, Data2=populate_2d)
panel = Panel(ghpython_script.console)
panel_2 = Panel(ghpython_script.points)
panel_3 = Panel(merge)
panel_4 = Panel(ghpython_script.pList)
